# Grasshopper definition solar_path_main.gh (Grasshopper 1.0.7)

degrees = Slider(0, range=0..89)
minutes = Slider(0, range=0..60)
division = Division(A=minutes, B=60)
list = ValueList({"Equinox": 0, "Summer Solstice": 23.45, "Winter Solstice": -23.45}, selected="Equinox")
addition = Addition(A=degrees, B=division)
series = Series(Start=-90, Step=15, Count=13)
c_script = CSharpScript(r=Slider(100, range=0..100), HRA=series, LAT=addition, DEC=list)  # -> out, rs, ds, rsr; inputs r: Double, HRA: Double, LAT: Double, DEC: Double
# ---------- c_script: C# ----------
    double deg = (180.0 / Math.PI);

    double ALT = deg * (Math.Asin((Math.Sin(DEC * deg) * Math.Sin(LAT * deg)) + (Math.Cos(DEC * deg) * Math.Cos(LAT * deg) * Math.Cos(HRA * deg))));


    if (ALT < 0)
    {
      ALT = (ALT * -1);
    } else {
      ALT = ALT * (1);
    }

    List<double> ALT_list = new List<double>();
    ALT_list.Add(ALT);

    List<double> ALT_list_corrected = new List<double>();

    foreach (double i in ALT_list){
      ALT_list_corrected.Add(i + 1.0);
    }


    rs = r * Math.Cos(DEC) / (Math.Sin(ALT) + Math.Sin(DEC));
    ds = r * Math.Cos(LAT) / (Math.Sin(LAT) + Math.Sin(DEC));
    rsr = ALT_list_corrected;
# ---------- end c_script ----------
c_script_2 = CSharpScript(x=series)  # -> out, A; inputs x: Double
# ---------- c_script_2: C# ----------
    A = x * (180/Math.PI);
# ---------- end c_script_2 ----------
subtraction = Subtraction(A=c_script.rs, B=c_script.ds)
c_script_3 = CSharpScript(x=Slider(90, range=0..100))  # -> out, A; inputs x: Double
# ---------- c_script_3: C# ----------
    if (x < 10){
      A = x;
    }
# ---------- end c_script_3 ----------
panel = Panel(c_script_2.A)
arc = Arc(Plane=PlaneXY(0, 0, 0), Radius=c_script.ds, Angle=Domain(0, 3.141592654))  # -> Arc, Length
panel_2 = Panel(c_script.rsr)
cos = Cosine(Value=3.14159)
series_2 = Series(Start=0, Step=1, Count=25)
panel_3 = Panel(cos)
panel_4 = Panel(c_script.rs)
pt = ConstructPoint(XCoordinate=flatten(series_2), YCoordinate=flatten(c_script.rs), ZCoordinate=0)
